# Dynamo graph DYN_01.1_STRING_TEST.dyn (Dynamo 2.0.4.12684)

string = StringInput("This ")
string_2 = StringInput("Script ")
string_3 = StringInput("Still ")
string_4 = StringInput("Works ")
concat = String.Concat(string0=string, string1=string_2, string2=string_3, string3=string_4)
watch = Watch(concat)
