# Dynamo graph DYN_04-PLAYER-BY-LEVEL.dyn (Dynamo 2.3.0.5885)

family_types = FamilyTypes("RPC Male:Alex")  # graph input
number = DoubleInput(0)  # graph input
number_2 = DoubleInput(0)  # graph input
byCoordinates = Point.ByCoordinates(x=number, y=number_2)
levels = Levels("Level 1")  # graph input
byPointAndLevel = FamilyInstance.ByPointAndLevel(familyType=family_types, point=byCoordinates, level=levels)
geometry = Element.Geometry(element=byPointAndLevel)
code_block = CodeBlock { 0; }
code_block_2 = CodeBlock { 0; }
