# Dynamo graph DYN_05-3D-ROOM-TAG-RHYTHM.dyn (Dynamo 2.3.0.5885)
# packages: Rhythm 2020.7.25

family_types = FamilyTypes("3dRoomTag:Name, Number")  # graph input
boolean = BoolSelector(true)
n3DRoomTags = Custom[Rhythm.3DRoomTags](ThreeDRoomTag=family_types, RunMe=boolean)  # package Rhythm; This node will generate 3D room tags for all rooms in the model. (RFA in extra folder in Dynamo download)
